# Grasshopper definition Hi-res Img Exports.gh (Grasshopper 1.0.8)

# ---- group: Real-time Container
pipeline = GeometryPipeline(
    GroupByLayer=False,
    GroupByType=False,
    IncludeHidden=True,
    IncludeLocked=True,
    LayerFilter="B+G::Model::Concrete Walls",
    NameFilter="*",
    SublayerFiltering=True,
    TypeFilter=1073741848)
pipeline_2 = GeometryPipeline(
    GroupByLayer=False,
    GroupByType=False,
    IncludeHidden=True,
    IncludeLocked=True,
    LayerFilter="B+G::Model::Concrete Floor",
    NameFilter="*",
    SublayerFiltering=True,
    TypeFilter=1073741848)
pipeline_3 = GeometryPipeline(
    GroupByLayer=False,
    GroupByType=False,
    IncludeHidden=True,
    IncludeLocked=True,
    LayerFilter="B+G::Model::Stone Walls",
    NameFilter="*",
    SublayerFiltering=True,
    TypeFilter=1073741848)

# ----
# Button to toggle b/w sync and async modelling
toggle = BooleanToggle(False)

# ---- group: Geometric Container
concrete_walls = Geometry([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])
concrete_floors = Geometry([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])
stone_walls = Geometry([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])

# ----
filter = StreamFilter(Gate=toggle, Stream0=stone_walls, Stream1=pipeline_3)
filter_2 = StreamFilter(Gate=toggle, Stream0=concrete_floors, Stream1=pipeline_2)
filter_3 = StreamFilter(Gate=toggle, Stream0=concrete_walls, Stream1=pipeline)
