# Grasshopper definition test.gh (Grasshopper 1.0.8)
# plug-ins: Karamba3D, RhinoCodePluginGH, ScriptParasite

X = UnitX(Factor=1)
line = LineSDL(Start="0,1,0", Direction=X, Length=Slider(3, range=1..5))
lineelem = CreateLinearElementKaramba3D(
    Line=line,
    LimitDistance_m=0.005,
    BucklingLengthY_m=-1,
    BucklingLengthZ_m=-1,
    BucklingLengthLT_m=-1,
    Bending=True,
    ToPolylineMaxAngle=0.25,
    ToPolylineTolerance=0.1,
    ToPolylineMaxEdgeLength=0.25,
    New=True,
    Remove=True,
    mode="LineToBeam")  # -> Element, Points, Info
assemble = AssembleModelKaramba3D(Elem=lineelem.Element, LimitDistance_m=0.005)  # -> Model, Info, Mass_kg, CentreOfGravity, LoadCaseNames
panel = Panel("K:\2019\F-19-02_Ferney-Voltaire_Logements_Perraudin\3_AUTRES\B+G_Paramétrisation portiques équivalents\Modèle Rhino+GH\250122_K-EFM Project\EFM-WIP\src\WorkingFiles\c# script editor files\karamaba")

scriptpar = ScriptParasite(Enable=Toggle(False), Folder="C:\DEV\C# temp")
c_script = CSharpScript(
    Model_in=assemble.Model,
    Reference=["C:\Program Files\Rhino 8\Plug-ins\Karamba\karamba.gha", "C:\Program Files\Rhino 8\Plug-ins\Karamba\karambaCommon.dll"])  # -> out, A
# ---------- c_script: C# usings ----------
using System.Threading;
using System.Threading.Tasks;
using System.Linq;
using Karamba.Models;
using KarambaCommon;
using Karamba;
# ---------- c_script: C# ----------
    Toolkit k3d = new Toolkit();  
    var model = Model_in as Model;
    var elem = model.elems[0];
    A = elem;
# ---------- end c_script ----------

c_script_2 = CSharpScript(
    Model_in=assemble.Model,
    Reference=["C:\Program Files\Rhino 8\Plug-ins\Karamba\karamba.gha", "C:\Program Files\Rhino 8\Plug-ins\Karamba\karambaCommon.dll"])  # -> out, A
# ---------- c_script_2: C# usings ----------
using System.Threading;
using System.Threading.Tasks;
using System.Linq;
using Karamba.Models;
using KarambaCommon;
# ---------- c_script_2: C# ----------
    Toolkit k3d = new Toolkit();  
    var model = Model_in as Model;
    var elem = model.elems[0];
    A = elem;
# ---------- end c_script_2 ----------
scriptpar_2 = ScriptParasite(Enable=Toggle(False), Folder=panel)

c_script_3 = CSharpScript(Model_in=assemble.Model)  # -> out, a
# ---------- c_script_3: C# ----------
// Grasshopper Script Instance
#region Usings
using System;
#r "C:\Program Files\Rhino 8\Plug-ins\Karamba\karambaCommon.dll"
#r "C:\Program Files\Rhino 8\Plug-ins\Karamba\karamba.gha"
using System.Linq;
using System.Collections;
using System.Collections.Generic;
using System.Drawing;

using Rhino;
using Rhino.Geometry;

using Grasshopper;
using Grasshopper.Kernel;
using Grasshopper.Kernel.Data;
using Grasshopper.Kernel.Types;

using Karamba.Models;
using KarambaCommon;
#endregion

public class Script_Instance : GH_ScriptInstance
{
    #region Notes
    /* 
      Members:
        RhinoDoc RhinoDocument
        GH_Document GrasshopperDocument
        IGH_Component Component
        int Iteration

      Methods (Virtual & overridable):
        Print(string text)
        Print(string format, params object[] args)
        Reflect(object obj)
        Reflect(object obj, string method_name)
    */
    #endregion

    private void RunScript(object Model_in, object y, ref object a)
    {
        Toolkit k3d = new Toolkit();  
        var model = Model_in as Model;
        var elem = model.elems[0];
        a = elem;
        
    }
}
# ---------- end c_script_3 ----------
panel_2 = Panel(c_script_2.A)
panel_3 = Panel(c_script_3.a)
